# Dynamo graph script.dyn (Dynamo 2.6.2.15705)
# packages: Data-Shapes 2021.2.94, Genius Loci 2021.11.10, Clockwork for Dynamo 2.x 2.4.0, Orchid 200.4.0.7938, spring nodes 210.1.1, Crumple 2022.2.13

code_block = CodeBlock { "Crear Comentario"; }
code_block_2 = CodeBlock { "INICIAR"; "CANCELAR"; 500; 150; }
code_block_3 = CodeBlock { "Seleccionar los Elementos"; }
code_block_4 = CodeBlock { "SELECCIONAR"; }
selectmodelelements_data_ordered = Custom[SelectModelElements Data (ordered)](InputName=code_block_3, ButtonText=code_block_4)  # package Data-Shapes; Creates a Revit element selection input for UI.MultipleInputForm++ . Check out www.data-shapes.net for more infos!
code_block_5 = CodeBlock { "Escribir Comentario"; }
textbox_data = Custom[TextBox Data](InputName=code_block_5)  # package Data-Shapes; Create Data for TextBox input in UI.MultipleInputForm ++ . Check out www.data-shapes.net for more informations
list_create = List.Create(item0=selectmodelelements_data_ordered, item1=textbox_data)
inputgroup_data = Custom[InputGroup Data](Inputs=list_create)  # package Data-Shapes; Creates a group of inputs for UI.MultipleInputForm ++ . Check out www.data-shapes.net for more infos !
code_block_6 = CodeBlock { "Enviar a:"; }
code_block_7 = CodeBlock()
# ---------- code_block_7.designscript (5 lines) ----------
[
"José Núñez 1 - ji.nunezn@live.cl",
"José Núñez 2 - jose.nunez@arainco.cl",
"José Núñez 3 - ji.nunezn@gmail.com"
];
# ----------------------------------------
code_block_8 = CodeBlock { " - "; }
split = String.Split(str=code_block_7, separator0=code_block_8)
lastItem = List.LastItem(list=split@L2)
listview_data = Custom[Listview Data](Keys=code_block_7, Values=lastItem)  # package Data-Shapes; Create data for ListView input in UI.MultiInputForm ++ . Check out www.data-shapes.net for more infos.
inputgroup_data_2 = Custom[InputGroup Data](GroupTitle=code_block_6, Inputs=listview_data)
list_create_2 = List.Create(item0=inputgroup_data, item1=inputgroup_data_2)
boolean = BoolSelector(true)
multipleinputform = Custom[MultipleInputForm ++](Description_optional=code_block, ButtonText_optional=code_block_2.out0, Inputs=list_create_2, Toggle=boolean, CancelButtonText_optional=code_block_2.out1, Width_optional=code_block_2.out2, LabelWidth_optional=code_block_2.out3)  # package Data-Shapes; Create a form with multiple inputs. see www.data-shapes.net for tutorials and infos!
code_block_9 = CodeBlock(x=multipleinputform.User_Inputs)
# ---------- code_block_9.designscript (36 lines) ----------
x;
[Imperative]
{
	if(x == null)
	{
		return = [];
	}
	else
	{
		return = x[0];
	}
};

[Imperative]
{
	if(x == null)
	{
		return = [];
	}
	else
	{
		return = x[1];
	}
};

[Imperative]
{
	if(x == null)
	{
		return = [];
	}
	else
	{
		return = x[2];
	}
};
# ----------------------------------------
byUnion = Solid.ByUnion()  # unwired: solids
code_block_10 = CodeBlock(x=code_block_9.out1) { x; }
geometry = Element.Geometry(element=code_block_10)
flatten = List.Flatten(list=geometry)
function_apply = ApplyFunction(func=byUnion, arg1=flatten)
code_block_11 = CodeBlock(x=function_apply)
# ---------- code_block_11.designscript (12 lines) ----------
x;
[Imperative]
{
	if(x == null)
	{
		return = [];
	}
	else
	{
		return = x;
	}
};
# ----------------------------------------
boundingBox = Geometry.BoundingBox(geometry=code_block_11.out1)
code_block_12 = CodeBlock { 2; }
ꟿ_boundingbox_scale = Custom[ꟿ BoundingBox.Scale](boundingBox=boundingBox, xAmmount=code_block_12, yAmmount=code_block_12, zAmmount=code_block_12)  # package spring nodes; Scales the bounding box in three dimensions according to it's center.
firstItem = List.FirstItem()  # unwired: list
workset = Custom[Element.Workset](element=code_block_10)  # package Clockwork for Dynamo 2.x; Retrieves the workset of a given element
toOrchidType = Orchid.RevitProject.Common.Workset.ToOrchidType(workset=workset)
name = Orchid.RevitProject.Common.Workset.Name(workset=toOrchidType)
function_apply_2 = ApplyFunction(func=firstItem, arg1=name)
n3dview_collector = Custom[3DView Collector]()  # package Genius Loci; Retrieves the 3D views in the active or given document.
name_2 = Element.Name(element=n3dview_collector)
code_block_13 = CodeBlock { "_"; }
split_2 = String.Split(str=name_2, separator0=code_block_13)
code_block_14 = CodeBlock { 0; }
getItemAtIndex = List.GetItemAtIndex(list=split_2@L2, index=code_block_14)
uniqueItems = List.UniqueItems(list=name)
eq = getItemAtIndex == uniqueItems  # lacing=Longest
countTrue = List.CountTrue(list=eq)
code_block_15 = CodeBlock(num=countTrue) { num+1; }
code_block_16 = CodeBlock(wn=function_apply_2, num=code_block_15) { wn+"_COMENTARIO "+num; }
n3dview_by_boundingbox = Custom[3DView by BoundingBox](boundingBox=ꟿ_boundingbox_scale, viewName=code_block_16)  # package Genius Loci; Use a boundingbox to create a new 3D View with a specified name. Note: Use the "Remove Special Characters from String" node to obtain a view name without prohibited characters.
code_block_17 = CodeBlock { "Comentario"; }
setParameterByName = Element.SetParameterByName(element=n3dview_by_boundingbox, parameterName=code_block_17, value=code_block_9.out2)
code_block_18 = CodeBlock { "Estatus Comentario"; 0; }
setParameterByName_2 = Element.SetParameterByName(element=setParameterByName, parameterName=code_block_18.out0, value=code_block_18.out1)
code_block_19 = CodeBlock(x=code_block_9.out1) { x; }
code_block_20 = CodeBlock { "<Solid fill>"; }
getByName = FillPatternElement.GetByName(name=code_block_20)
color_palette = ColorPalette({R: 255, G: 69, B: 0, A: 255})
create_overridegraphicsettings = Custom[Create OverrideGraphicSettings](SurfaceForegroundPattern=getByName, SurfaceForegroundPatternColor=color_palette, CutForegroundPattern=getByName, CutForegroundPatternColor=color_palette)  # package Genius Loci; Create a OverrideGraphicSettings (All graphic inputs are optional). Unlike the OOTB OverrideGraphicSettings.ByProperties node, the Foreground and background patterns are available. Note : Prior to Revit 2019, the materials have only one surface pattern and one cut pattern.
code_block_21 = CodeBlock { false; }
view_setelementoverrides = Custom[View SetElementOverrides](view=setParameterByName_2, elements=code_block_19, overrides=create_overridegraphicsettings, hide=code_block_21, lacing=Longest)  # package Genius Loci; Overrides element graphics settings in the given view. For use with the Create OverrideGraphicSettings node. Can also be used to hide or unhide elements.
code_block_22 = CodeBlock { null; }
replaceEmptyLists = Custom[List.ReplaceEmptyLists](seq=view_setelementoverrides, Replacement=code_block_22)  # package Clockwork for Dynamo 2.x; Replaces all empty lists within a given list with a substitute
code_block_23 = CodeBlock(x=replaceEmptyLists)
# ---------- code_block_23.designscript (12 lines) ----------
x;
[Imperative]
{
	if(x == null)
	{
		return = [];
	}
	else
	{
		return = x[0];
	}
};
# ----------------------------------------
code_block_24 = CodeBlock { "View Name"; }
getParameterValueByName = Element.GetParameterValueByName(element=code_block_23.out1, parameterName=code_block_24)
ꟿ_document_centralpath = Custom[ꟿ Document.CentralPath]()  # package spring nodes; If the document is workshared, the node returns the path to the central document as a string. Otherwise a null value will be returned.
code_block_25 = CodeBlock { "\\"; }
split_3 = String.Split(str=ꟿ_document_centralpath, separator0=code_block_25)
lastItem_2 = List.LastItem(list=split_3)
code_block_26 = CodeBlock(vN=getParameterValueByName, centralModel=lastItem_2) { vN+"_"+centralModel; }
code_block_27 = CodeBlock { "Comentario"; }
getParameterValueByName_2 = Element.GetParameterValueByName(element=code_block_23.out1, parameterName=code_block_27)
code_block_28 = CodeBlock(comentario=getParameterValueByName_2) { "Estimad@; \n"+comentario; }
outlooksend = Custom[© OutlookSend](to=code_block_9.out3, subject=code_block_26, body=code_block_28)  # package Crumple; Given Outlook is open, this node will attempt to send an email to a list of recipients with a subject and body.
